# Grasshopper definition KeystoneDebugging.gh (Grasshopper 0.9.80)
# plug-ins: Python Interpreter

srf = Surface([<surface referenced from the Rhino model> x3])
srf_2 = Surface([<surface referenced from the Rhino model> x3])
rev = ReverseList(List=srf)
item = ListItem(List=rev, Index=Slider(0, range=0..3), Wrap=True)
merge = Merge(Data1=rev, Data2=srf_2)
python = PythonScript(v_div=Slider(8, range=0..10), blend_p=Slider(0, range=0..10), srf_set_a=rev, srf_set_b=srf_2)  # -> out, a, b, unpacked_source, unpacked_keystones; inputs v_div: Int32, blend_p: Int32, srf_set_a: list of Surface, srf_set_b: list of Surface
# ---------- python: Python ----------
execfile("/Users/jonas/Dropbox/0.dfab/Trimester 2/Project I - Gradual Assemblies/Gradual-Assemblies/UR_Control/geometry/surface_keystone.py")

a, b = Keystone([srf_set_a, srf_set_b], v_div, blend_p, 1).output()

print a

unpacked_keystones = []
unpacked_source = []
for temp_srf in b:
	for srf in temp_srf:
		unpacked_keystones.append(srf)

for temp_srf in a:
	for srf in temp_srf:
		unpacked_source.append(srf)
# ---------- end python ----------
item_2 = ListItem(List=python.unpacked_keystones, Index=0, Wrap=True)  # -> Item, Item1
srf_3 = Surface(python.unpacked_keystones)
panel = Panel(python.out)
