# Grasshopper definition uvFieldFunction.gh (Grasshopper 0.9.80)
# plug-ins: Python Interpreter

srf = Surface(<surface referenced from the Rhino model>)
list = ValueList({"None": 0, "u swap": 1, "v swap": 2, "uv-swap": 3}, selected="uv-swap")
list_2 = ValueList({"None": 0, "Sin": 1}, selected="Sin")
dividecurve = PythonScript(
    surfaces=srf,
    u_divisions=Slider(10, range=10..100),
    v_divisions=Slider(51, range=10..100),
    warp_type=list_2,
    swap_uv=Toggle(False),
    change_direction=list)  # -> out, global_points, line_1, line_2, beam_breps, spheres_angles, surface, point_list, pts, isocurves; inputs surfaces: Surface, warp_type: Int32, swap_uv: Boolean, change_direction: Int32
# ---------- dividecurve: Python ----------
# snippet of code to make this python component look for it's code in the parent folder of the .gh file

import os

ghComp = ghenv.Component
ghDoc = ghComp.OnPingDocument()

file_name = "uvFieldFunction.py"
gh_file_location = ghDoc.FilePath
parent = os.path.dirname(os.path.realpath(gh_file_location))

file_path = os.path.join(parent, file_name)
print file_path

parent = os.path.dirname(os.path.realpath(parent))
parent = os.path.dirname(os.path.realpath(parent))
print parent

# hacky-hacky run-fun
execfile(file_path)
# ---------- end dividecurve ----------
crv = Curve(dividecurve.isocurves)
brep = Brep(dividecurve.surface)
pt = Point(dividecurve.point_list)
pt_2 = Point(dividecurve.pts)
panel = Panel(dividecurve.out)
item = ListItem(List=pt, Index=Slider(410, range=10..2000), Wrap=True)
pt_3 = Point(item)
